# Grasshopper definition hops_hui.gh (Grasshopper 1.0.7)
# plug-ins: Weaverbird, Hops, Lionfish, NGon, LunchBox, Bowerbird2, MeshEdit Components

trigger = Trigger(Interval=-1000, TimerInterval=1000)
hops = Hops(
    CacheResultsInMemory=False,
    CacheSolveResults=False,
    RemoteSolveVersion=(0, 1, 0),
    ShowInput_Enabled=False,
    ShowInput_Path=True,
    SynchronousSolve=True)
hops_2 = Hops(
    CacheResultsInMemory=False,
    CacheSolveResults=False,
    RemoteSolveVersion=(0, 1, 0),
    ShowInput_Enabled=False,
    ShowInput_Path=True,
    SynchronousSolve=True)
hops_3 = Hops(
    CacheResultsInMemory=False,
    CacheSolveResults=False,
    RemoteSolveVersion=(0, 1, 0),
    ShowInput_Enabled=False,
    ShowInput_Path=True,
    SynchronousSolve=True)
hops_4 = Hops(
    CacheResultsInMemory=False,
    CacheSolveResults=False,
    RemoteSolveVersion=(0, 1, 0),
    ShowInput_Enabled=False,
    ShowInput_Path=True,
    SynchronousSolve=True)
hops_5 = Hops(
    CacheResultsInMemory=False,
    CacheSolveResults=False,
    RemoteSolveVersion=(0, 1, 0),
    ShowInput_Enabled=False,
    ShowInput_Path=True,
    SynchronousSolve=True)
hops_6 = Hops(
    CacheResultsInMemory=False,
    CacheSolveResults=False,
    RemoteSolveVersion=(0, 1, 0),
    ShowInput_Enabled=False,
    ShowInput_Path=True,
    SynchronousSolve=True)
hops_7 = Hops(
    CacheResultsInMemory=False,
    CacheSolveResults=False,
    RemoteSolveVersion=(0, 1, 0),
    ShowInput_Enabled=False,
    ShowInput_Path=True,
    SynchronousSolve=True)
hops_8 = Hops(
    CacheResultsInMemory=False,
    CacheSolveResults=False,
    RemoteSolveVersion=(0, 1, 0),
    ShowInput_Enabled=False,
    ShowInput_Path=True,
    SynchronousSolve=True)

# ---- group: 1st or 2nd poly
number_slider = Slider(0, range=0..1)  # disabled

# ----
hops_9 = Hops(
    CacheResultsInMemory=False,
    CacheSolveResults=False,
    RemoteSolveVersion=(0, 1, 0),
    ShowInput_Enabled=False,
    ShowInput_Path=True,
    SynchronousSolve=True)
hops_10 = Hops(
    CacheResultsInMemory=False,
    CacheSolveResults=False,
    RemoteSolveVersion=(0, 1, 0),
    ShowInput_Enabled=False,
    ShowInput_Path=True,
    SynchronousSolve=True)

a_net_diag = BooleanToggle(False)  # disabled
a_net = BooleanToggle(False)  # disabled

g_net_diag = BooleanToggle(False)  # disabled
g_net = BooleanToggle(False)  # disabled

hops_11 = Hops(
    CacheResultsInMemory=False,
    CacheSolveResults=False,
    RemoteSolveVersion=(0, 1, 0),
    ShowInput_Enabled=False,
    ShowInput_Path=True,
    SynchronousSolve=True)
hops_12 = Hops(
    CacheResultsInMemory=False,
    CacheSolveResults=False,
    RemoteSolveVersion=(0, 1, 0),
    ShowInput_Enabled=False,
    ShowInput_Path=True,
    SynchronousSolve=True)
hops_13 = Hops(
    CacheResultsInMemory=False,
    CacheSolveResults=False,
    RemoteSolveVersion=(0, 1, 0),
    ShowInput_Enabled=False,
    ShowInput_Path=True,
    SynchronousSolve=True)

gga = BooleanToggle(False)  # disabled
agg = BooleanToggle(False)  # disabled

aag = BooleanToggle(False)  # disabled
gaa = BooleanToggle(False)  # disabled

aagg = BooleanToggle(False)  # disabled
ggaa = BooleanToggle(True)  # disabled

hops_14 = Hops(
    CacheResultsInMemory=False,
    CacheSolveResults=False,
    RemoteSolveVersion=(0, 1, 0),
    ShowInput_Enabled=False,
    ShowInput_Path=True,
    SynchronousSolve=True)

enneper = EnneperSurface(
    UDivisions=100,
    VDivisions=100,
    RParameter=Slider(4, range=0..10),
    Scale=15,
    Domain1=Domain(0, 1),
    Domain2=Domain(-3.141592654, 3.141592654))

helicoid = HelicoidSurface(
    UDivisions=100,
    VDivisions=100,
    RParameter=2,
    TParameter=1,
    Scale=Slider(1, range=0..1),
    Domain1=Domain(-6.283185307, 6.283185307),
    Domain2="-pi to pi")

# ----
# WW_spiral_minimal3
srf = Surface(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)

# ----
# WW_spiral_minimal2
srf_2 = Surface(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)

# ----
# WW_spiral_minimal1
srf_3 = Surface(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)

# ----
# k1/k2=-1, -2, -4
surface = Surface(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)
surface_2 = Surface(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)
surface_3 = Surface(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)

# ----
# Input Surface
lamella_surfaces = Surface([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])

# ----
# scale input surface into unit-diameter
geometry = Geometry(surface)
bounding_box = BoundingBox(Content=geometry, Plane=PlaneXY(0, 0, 0))  # -> Box, Box_2
box_properties = BoxProperties(Box=bounding_box.Box)  # -> Center, Diagonal, Area, Volume, Degeneracy
scale = Scale(Geometry=geometry, Center=box_properties.Center, Factor=expr("1/x", box_properties.Diagonal))  # -> Geometry, Transform
move = Move(Geometry=scale.Geometry, Motion=expr("-x", box_properties.Center))  # -> Geometry, Transform

# ---- group: 1st or 2nd poly
number_slider_2 = Slider(1, range=0..1)

# ---- group: Iterations
# Guided Projection Algorithm Settings
iter = Slider(10, range=5..20)

# ---- group: weight_fairness
fairness = Panel("0.001")
fairness_2 = Panel("0.005")
fairness_3 = Panel("0.0005")
number = Number(fairness_2)

# ---- group: weight_self-closeness
closness = Panel("0.01")
closness_2 = Panel("0")
number_2 = Number(closness)

# ---- group: eps
epsilon = Panel("0.001")
number_3 = Number(epsilon)

# ---- group: minimal_3noid_1_patch_unitscale
mesh = Mesh(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)

# ---- group: a1gnet2_2g+voss+asy_unitscale
mesh_2 = Mesh(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)

# ----
panel = Panel("AGG")
panel_2 = Panel("GGA")

panel_3 = Panel("AAG")

panel_4 = Panel("AAGG")
panel_5 = Panel("GGAA")

panel_6 = Panel("Anet")
panel_7 = Panel("AnetDiagnet")

panel_8 = Panel("Gnet")
panel_9 = Panel("GnetDiagnet")

local = Panel("http://localhost:5000/processMesh")
mine = Panel("http://127.0.0.1:5000/processMesh")
# Path
florian_s = Panel("http://10.68.74.6:5000/processMesh")
local_2 = Panel("http://localhost:5000/read_1_mesh")

# ---- group: Optimize
trigger_2 = Trigger(Interval=-1000, TimerInterval=1000, Target=hops_15)

# ---- group: 2. select surface
brep = Brep(move.Geometry)

# ---- group: web
panel_10 = Panel("GAA")
restart = BooleanToggle(True)

# ----
# 提取曲面上边界点 （均匀的点）
number_slider_3 = Slider(20, range=0..100)
sdivide = DivideSurface(Surface=brep, UCount=number_slider_3, VCount=number_slider_3)  # -> Points, Normals, Parameters
flip = FlipMatrix(Data=sdivide.Points)
item = ListItem(List=flip, Index="-1", Wrap=True)  # -> simplify(flatten(Item))
intcrv = Interpolate(Vertices=item, Degree=3, Periodic=False, KnotStyle=1)  # -> Curve, Length, Domain
divide = DivideCurve(Curve=intcrv.Curve, Count=number_slider_3, Kinks=False)  # -> Points, Tangents, Parameters
srf_cp = SurfaceClosestPoint(Point=divide.Points, Surface=brep)  # -> Point, UVPoint, Distance

# ---- group: Surf-->Mesh
# Inputs Mesh
mesh_frompoints = MeshFromPoints(Points=flatten(sdivide.Points), UDirection=expr("x+1", number_slider_3), VDirection=expr("x+1", number_slider_3))

# ----
weaverbird_s_face_polylines = WeaverbirdsFacePolylines(Mesh=mesh_frompoints)

# ---- group: input quadmesh
mesh_3 = Mesh(mesh_frompoints)

# ---- group: 1. choose path type
bbκn = BBNormalCurvaturePath(Value=0, Angle=0, Direction=3)

# ----
# Process
hops_15 = Hops(
    _Path=local_2,
    Mesh=mesh_3,
    Iteration=iter,
    Fairness=number,
    W2Closeness=number_2,
    Direction=number_slider_2,
    Web=panel_10,
    Restart=restart,
    CacheResultsInMemory=False,
    CacheSolveResults=False,
    RemoteDefinitionLocation="http://localhost:5000/read_1_mesh",
    RemoteSolveVersion=(0, 1, 0),
    ShowInput_Enabled=False,
    ShowInput_Path=True,
    SynchronousSolve=True)  # -> Mesh, Vertices, Normal

item_2 = ListItem(List=sdivide.Points, Index="-1", Wrap=True)  # -> simplify(flatten(Item))
intcrv_2 = Interpolate(Vertices=item_2, Degree=3, Periodic=False, KnotStyle=1)  # -> Curve, Length, Domain
divide_2 = DivideCurve(Curve=intcrv_2.Curve, Count=number_slider_3, Kinks=False)  # -> Points, Tangents, Parameters
srf_cp_2 = SurfaceClosestPoint(Point=divide_2.Points, Surface=brep)  # -> Point, UVPoint, Distance

# ---- group: 4. run pathfinder
bbpathfinder = BBPathfinder(
    PathType=bbκn,
    Surface=brep,
    StartPoint=[srf_cp.Point, srf_cp_2.Point],
    StepSize=0.1,
    MaximumNumberOfPoints=10000,
    StartPointType=0)  # -> simplify(Paths)

# ---- group: vertices
point = Point(hops_15.Vertices)

# ---- group: normal
vector = Vector(hops_15.Normal)

# ---- group: output quadmesh
# Outputs
mesh_4 = Mesh(hops_15.Mesh)

# ---- group: weight_fairness_Bezier-Ctrl-Pts
panel_11 = Panel("0.01")
panel_12 = Panel("0.05")
number_4 = Number("0.005")

# ----
# get Beziersplines + Frenet frame + rulings + strips + unrollment
local_3 = Panel("http://localhost:5000/bezier_splinessss_strip")

# ---- group: weight_fairness_strip
number_5 = Number("0.005")

# ----
checker_vertices = BooleanToggle(True)

# ---- group: num_dense_ruling
panel_15 = Panel("20")

# ---- group: width
panel_16 = Panel("0.5")

# ---- group: dist_interval
panel_17 = Panel("1.5")

# ----
optruling = BooleanToggle(True)
singular = BooleanToggle(False)
dense = BooleanToggle(True)

# ---- group: ith-poly
panel_18 = Panel("1")
panel_19 = Panel("2")
panel_20 = Panel("4")
integer = Integer("3")

# ----
number_6 = Number(panel_15)
number_7 = Number(panel_17)
number_8 = Number(panel_16)
trigger_3 = Trigger(Interval=-1000, TimerInterval=1000, Target=hops_18)

# ----
# intersect points
bbpathfinder_2 = BBPathfinder(PathType=bbκn, Surface=brep, StartPoint=srf_cp_2.Point, StepSize=0.1, MaximumNumberOfPoints=10000, StartPointType=0)
bbpathfinder_3 = BBPathfinder(PathType=bbκn, Surface=brep, StartPoint=srf_cp.Point, StepSize=0.1, MaximumNumberOfPoints=10000, StartPointType=0)
lng = ListLength(List=srf_cp.Point)
dom = ConstructDomain(DomainStart=expr("1", 0), DomainEnd=expr("x-1", lng))
item_3 = ListItem(List=bbpathfinder_3, Index=dom, Wrap=True)
deconstruct = BBDeconstructCurveOnSurface(CurveOnSurface=item_3)  # -> Surface, Curve, Approximation
deconstruct_2 = BBDeconstructCurveOnSurface(CurveOnSurface=bbpathfinder_2)  # -> Surface, Curve, Approximation
crv = Curve(reparameterize(flatten(deconstruct.Approximation)))
crv_2 = Curve(reparameterize(flatten(deconstruct_2.Approximation)))
ccx = CurveCurve(CurveA=graft(crv), CurveB=crv_2)  # -> simplify(flatten(Points)), simplify(flatten(ParamsA)), simplify(flatten(ParamsB))

# ----
# Optimized mesh vertex-normals
weaverbird_s_mesh_edges = WeaverbirdsMeshEdges(MeshOrPolylines=mesh_4)
# Visulization
length = Length(Curve=weaverbird_s_mesh_edges)
average = Average(Input=length)
amplitude = Amplitude(Vector=vector, Amplitude=average)
addition = Addition(A=point, B=amplitude)
line = Line(StartPoint=point, EndPoint=addition)

# ----
# get 2 ctrl-polylines + 2 diag-polylines
local_4 = Panel("http://localhost:5000/polyline_4_directions")
trigger_4 = Trigger(Interval=-1000, TimerInterval=1000, Target=hops_16)
hops_16 = Hops(
    _Path=local_4,
    Mesh=mesh_4,
    CacheResultsInMemory=False,
    CacheSolveResults=False,
    RemoteDefinitionLocation="http://localhost:5000/polyline_4_directions",
    RemoteSolveVersion=(0, 1, 0),
    ShowInput_Enabled=False,
    ShowInput_Path=True,
    SynchronousSolve=True)  # -> Polyline1, Polyline2, Polyline3, Polyline4
line_2 = Line(hops_16.Polyline2)
line_3 = Line(hops_16.Polyline4)
line_4 = Line(hops_16.Polyline1)
line_5 = Line(hops_16.Polyline3)

# ----
# get checker vertices
local_5 = Panel("http://localhost:5000/checker_tianvertex")
trigger_5 = Trigger(Interval=-1000, TimerInterval=1000, Target=hops_17)
hops_17 = Hops(
    _Path=local_5,
    Mesh=mesh_4,
    CacheResultsInMemory=False,
    CacheSolveResults=False,
    RemoteDefinitionLocation="http://localhost:5000/checker_tianvertex",
    RemoteSolveVersion=(0, 1, 0),
    ShowInput_Enabled=False,
    ShowInput_Path=True,
    SynchronousSolve=True)  # -> P1, P2
point_2 = Point(hops_17.P2)
point_3 = Point(hops_17.P1)

hops_18 = Hops(
    _Path=local_3,
    Mesh=hops_15.Mesh,
    Web=panel_10,
    VN=hops_15.Normal,
    Ipoly=integer,
    W1CtrlPoint=number_4,
    W2Strip=number_5,
    NumDenser=number_6,
    Width=number_8,
    DistInterval=number_7,
    Checker=checker_vertices,
    DenseSparse=dense,
    OptRulingCmptRuling=optruling,
    SingularRegular=singular,
    CacheResultsInMemory=False,
    CacheSolveResults=False,
    RemoteDefinitionLocation="http://localhost:5000/bezier_splinessss_strip",
    RemoteSolveVersion=(0, 1, 0),
    ShowInput_Enabled=False,
    ShowInput_Path=True,
    SynchronousSolve=True)  # -> CtrlP, Indices, Bezier, An, E1, E2, E3, R, Strip, UnrollStrip
mesh_5 = Mesh(hops_18.Strip)
mesh_6 = Mesh(hops_18.UnrollStrip)
curve = Curve(hops_18.Bezier)

# ---- group: v
point_4 = Point(hops_18.An)

# ---- group: allP
point_5 = Point(hops_18.CtrlP)

# ---- group: e1
vector_2 = Vector(hops_18.E1)

# ---- group: e3
vector_3 = Vector(hops_18.E3)

# ---- group: r
vector_4 = Vector(hops_18.R)

# ---- group: e2
vector_5 = Vector(hops_18.E2)

# ----
weaverbird_s_mesh_edges_2 = WeaverbirdsMeshEdges(MeshOrPolylines=mesh_5)
weaverbird_s_mesh_edges_3 = WeaverbirdsMeshEdges(MeshOrPolylines=mesh_6)

# ----
# unit principal normal E2
amplitude_2 = Amplitude(Vector=vector_5, Amplitude=average)
addition_2 = Addition(A=point_4, B=amplitude_2)
line_6 = Line(StartPoint=point_4, EndPoint=addition_2)

# ----
# unit tangent E1
amplitude_3 = Amplitude(Vector=vector_2, Amplitude=average)
addition_3 = Addition(A=point_4, B=amplitude_3)
line_7 = Line(StartPoint=point_4, EndPoint=addition_3)

# ----
# unit Darboux(ruling) r
amplitude_4 = Amplitude(Vector=vector_4, Amplitude=average)
addition_4 = Addition(A=point_4, B=amplitude_4)
line_8 = Line(StartPoint=point_4, EndPoint=addition_4)

# ----
# unit binormal E3
amplitude_5 = Amplitude(Vector=vector_3, Amplitude=average)
addition_5 = Addition(A=point_4, B=amplitude_5)
line_9 = Line(StartPoint=point_4, EndPoint=addition_5)

number_slider_4 = Slider(0.01, range=0..0.2)
number_slider_5 = Slider(0, range=0..0.1)
clean = CleanTree(RemoveNulls=True, RemoveInvalid=True, RemoveEmpty=False, Tree=flatten(item_3))
# unroll into plane
extrude = BBExtrudeCurveOnSurface(CurveOnSurface=clean, Thickness=number_slider_4, Offset=number_slider_5, Smooth=True, Unroll=True)
number_slider_6 = Slider(0.1, range=0..1)
srf_4 = Surface(extrude)
lng_2 = ListLength(List=srf_4)
series = Series(Start=0, Step=number_slider_6, Count=lng_2)
X = UnitX(Factor=series)
move_2 = Move(Geometry=srf_4, Motion=X)  # -> Geometry, Transform

clean_2 = CleanTree(RemoveNulls=True, RemoveInvalid=True, RemoveEmpty=False, Tree=flatten(bbpathfinder_2))
extrude_2 = BBExtrudeCurveOnSurface(CurveOnSurface=clean_2, Thickness=number_slider_4, Offset=number_slider_5, Smooth=True, Unroll=True)
srf_5 = Surface(extrude_2)
lng_3 = ListLength(List=srf_5)
series_2 = Series(Start=0, Step=number_slider_6, Count=lng_3)
X_2 = UnitX(Factor=series_2)
move_3 = Move(Geometry=srf_5, Motion=X_2)  # -> Geometry, Transform

# ----
# check: geodesic between two vertices by <> way
naked_vertices = NakedVertices(Mesh=mesh_4)  # -> Vertices, Status
list_item = ListItem(List=naked_vertices.Vertices, Index="38", Wrap=True)
# Validation
list_item_2 = ListItem(List=naked_vertices.Vertices, Index="73", Wrap=True)
geodesiccurves = GeodesicCurves(Mesh=mesh_4, StartPoint=list_item_2, EndPoint=list_item)

# ----
# reshape a list
list_length = ListLength()  # disabled
list_item_3 = ListItem(Index=0, Wrap=True)  # disabled
multiplication = Multiplication(A=list_item_3, B=list_length)  # disabled
series_3 = Series(Start=0, Step=1, Count=multiplication)  # disabled
partition_list = PartitionList(List=series_3, Size=list_item_3)  # -> simplify(Chunks); disabled

# ---- group: unroll
srf_6 = Surface(move_2.Geometry)

srf_7 = Surface(move_3.Geometry)

# ----
# lamellal
extrude_3 = BBExtrudeCurveOnSurface(CurveOnSurface=clean, Thickness=number_slider_4, Offset=number_slider_5, Smooth=True, Unroll=False)
extrude_4 = BBExtrudeCurveOnSurface(CurveOnSurface=clean_2, Thickness=number_slider_4, Offset=number_slider_5, Smooth=True, Unroll=False)
merge = Merge(Data1=extrude_3, Data2=extrude_4)

# ----
# control_points + Bezier_splines
list_item_4 = ListItem(List=point_5, Index=partition_list, Wrap=True)  # disabled
control_points = Point(list_item_4)  # disabled
panel_21 = Panel("5")  # disabled
nurbs_curve = NurbsCurve(Vertices=control_points, Degree=panel_21, Periodic=False)  # -> Curve, Length, Domain; disabled

# ----
# evalue normal curvature at selected asymptote
item_4 = ListItem(List=flatten(bbpathfinder), Index=0, Wrap=True)
range = Range(Domain=Domain(0, 1), Steps=number_slider_3)

# ---- group: 6. measure normal curvature
κn = BBNormalCurvatureCurveOnSurface(CurveOnSurface=reparameterize(item_4), Parameter=range)  # -> Point, simplify(flatten(Curvature)), OsculatingCircle

# ----
vlen = VectorLength(Vector=κn.Curvature)
bnd = Bounds(Numbers=vlen)
panel_22 = Panel(bnd)
